# Dynamo graph ADICIONAR BTUS OS ELEMENTOS CONECTADOS.dyn (Dynamo 3.3.0.6316)
# packages: OpenMEP 1.0.0, Rhythm 2024.10.1

# group: Inputs do usuário
# Descrição <Clique duas vezes aqui para editar a descrição do grupo>
deseja_selecionar_os_elementos = BoolSelector(false)  # graph input
categoria_dos_elementos = Categories("OST_MechanicalEquipment")  # graph input
nome_do_parâmetro_de_potência = StringInput("BTU/H")  # graph input

# group: Seleciona elementos no Revit
# Descrição <Clique duas vezes aqui para editar a descrição do grupo>
boolean = BoolSelector(true)
ʳʰʸᵗʰᵐ_selection_pick = Rhythm.Revit.Selection.Selection.Pick(runIt=boolean, category=categoria_dos_elementos)

# group: Obtém todos os elementos da categoria e filtra as condensadoras
# Descrição <Clique duas vezes aqui para editar a descrição do grupo>
all_elements_of_category = ElementsOfCategory(Category=categoria_dos_elementos)
code_block = CodeBlock { "Família e tipo"; }
getParameterValueByName = Element.GetParameterValueByName(element=all_elements_of_category, parameterName=code_block)
family = FamilyType.Family(familyType=getParameterValueByName)
name = Family.Name(family=family)
filtrar_por = StringInput("Condensadora")  # graph input
code_block_2 = CodeBlock { true; }
contains = String.Contains(string=name, searchFor=filtrar_por, ignoreCase=code_block_2)
filterByBoolMask = List.FilterByBoolMask(list=all_elements_of_category, mask=contains)

# group: Controla o fluxo para selcionar os elemento ou obter todos pela categoria
# Descrição <Clique duas vezes aqui para editar a descrição do grupo>
scopeIf = ScopedIf(test=deseja_selecionar_os_elementos, true=ʳʰʸᵗʰᵐ_selection_pick, false=filterByBoolMask.in)
code_block_3 = CodeBlock {  }

# group: Obtém todos os elementos conectados
# Descrição <Clique duas vezes aqui para editar a descrição do grupo>
getElementConnectedContinuous = OpenMEPRevit.ConnectorManager.Connector.GetElementConnectedContinuous(element=scopeIf)

# group: Filtra os elementos selecionados
# Descrição <Clique duas vezes aqui para editar a descrição do grupo>
code_block_4 = CodeBlock(itens=scopeIf, lista=getElementConnectedContinuous) { itens.Id != lista.Id; }
filterByBoolMask_2 = List.FilterByBoolMask(list=getElementConnectedContinuous, mask=code_block_4)

# group: Busca o tipo dos elemetos selecionados
# Descrição <Clique duas vezes aqui para editar a descrição do grupo>
tipo_do_elemento = StringInput("Tipo")
getParameterValueByName_2 = Element.GetParameterValueByName(element=scopeIf, parameterName=tipo_do_elemento)

# group: Obtém o valor de BTU/h dos elementos de referência
# Descrição <Clique duas vezes aqui para editar a descrição do grupo>
getParameterValueByName_3 = Element.GetParameterValueByName(element=getParameterValueByName_2, parameterName=nome_do_parâmetro_de_potência)
code_block_5 = CodeBlock { 0; }
round = Math.Round(number=getParameterValueByName_3, digits=code_block_5)

# group: Define o valor de BTU/h para os elementos conectados
# Descrição <Clique duas vezes aqui para editar a descrição do grupo>
elementos_modificados = Element.SetParameterByName(element=filterByBoolMask_2.in@L2, parameterName=nome_do_parâmetro_de_potência, value=round@L1)  # graph output
