# Dynamo graph COLORIR TAGS PELO FILTRO.dyn (Dynamo 3.3.0.6316)
# packages: Genius Loci 2024.2.26, Clockwork for Dynamo 2.x 2.6.0

# group: Obtém todas as tags de tubo na vista
categories = Categories("OST_PipeTags")
all_elements_of_category = ElementsOfCategory(Category=categories)
current = Document.Current()
activeView = Document.ActiveView(document=current)
all_elements_of_category_in_view = ElementsOfCategoryInView(Category=categories, View=activeView)

# group: Obtém o nome do sistema das tubulações
# note: Custom Node: GeniusLociv.2024.2.26
tag_taggedelement = Custom[Tag TaggedElement](tag=all_elements_of_category_in_view)  # package Genius Loci; Get tagged element. Unlike the OOTB node it works also for linked element, linked room, room, space and area categories.
code_block = CodeBlock { "Tipo de sistema"; }
getParameterValueByName = Element.GetParameterValueByName(element=tag_taggedelement, parameterName=code_block)
code_block_2 = CodeBlock(sistema=getParameterValueByName) { sistema.Name; }

# group: Agrupa os elementos pelo sistema
groupByKey = List.GroupByKey(list=all_elements_of_category_in_view, keys=code_block_2)
byKeysValues = DesignScript.Builtin.Dictionary.ByKeysValues(keys=groupByKey.uniqueKeys, values=groupByKey.groups)

# group: Obtem os parâmetros do modelo de vista
# note: Custom Node: GeniusLociv.2024.2.26
get_filter_overrides = Custom[Get Filter Overrides]()  # package Genius Loci; Get the view filter and its overrides from the given view. Note : Prior to Revit 2019, the materials have only one surface pattern and one cut pattern.

# group: Busca o sistema do filtro
filterRuleString = Custom[ParameterFilterElement.FilterRuleString](parameterFilterElement=get_filter_overrides.viewFilter)  # package Clockwork for Dynamo 2.x; Aggregates the filter rules of a given ParameterFilterElement into a human-readable string
python_script = Python(IN[0]=filterRuleString)  # IronPython3
# ---------- python_script.python (16 lines) ----------
# Script para Dynamo com IronPython 3
# Este script recebe uma lista de strings (IN[0]) e retorna uma lista com as últimas 6 letras de cada string.
# Se a string tiver menos de 6 caracteres, ela é retornada inteira.

# A entrada do Dynamo é fornecida na variável IN
lista_strings = IN[0]

def extrair_ultimas_seis(strings):
    """
    Recebe uma lista de strings e retorna uma lista contendo as últimas 6 letras de cada string.
    Se a string possuir menos de 6 caracteres, retorna a própria string.
    """
    return [s[-6:] if len(s) >= 6 else s for s in strings]

# Processa a lista e define a saída (OUT) para o Dynamo
OUT = extrair_ultimas_seis(lista_strings)
# ----------------------------------------
element_by_id = ElementById(Id=python_script)
code_block_3 = CodeBlock(sistema=element_by_id) { sistema.Name; }

# group: Obtem os elementos na ordem
valueAtKey = DesignScript.Builtin.Dictionary.ValueAtKey(dictionary=byKeysValues, key=code_block_3)

# group: Sobrepõe a cor do elemento na vista
overrideColorInView = Element.OverrideColorInView(element=valueAtKey@L2, color=get_filter_overrides.SurfaceForegroundPatternColor@L1)
