# Dynamo graph CRIAR NOVOS TIPOS COM BASE NO TIPO EXISTENTE.dyn (Dynamo 3.3.0.6316)

# group: Seleciona um elemento no modelo
select_model_element = DSModelElementSelection()  # 1 picked in the model

# group: Obtém o tipo da instância
code_block = CodeBlock { "Tipo"; }
getParameterValueByName = Element.GetParameterValueByName(element=select_model_element, parameterName=code_block)

parameters = Element.Parameters(element=getParameterValueByName)
watch = Watch(parameters)

# group: Obtém os valores das partes que compõem o tipo base
code_block_2 = CodeBlock { "Nome do tipo"; }
getParameterValueByName_2 = Element.GetParameterValueByName(element=getParameterValueByName, parameterName=code_block_2)
code_block_3 = CodeBlock { " - "; }
split = String.Split(string=getParameterValueByName_2, separator0=code_block_3)
codeblock = CodeBlock(value=split)
# ---------- codeblock.designscript (7 lines) ----------
tipo = value[0];
linhaMaterial = value[1];
identificador = value[2];
separador = " - ";

// Saída
parte_fixa = tipo + separador + linhaMaterial;
# ----------------------------------------

# group: DEFINA A VARIAÇÃO DO IDENTIFICADOR
code_block_4 = CodeBlock()
# ---------- code_block_4.designscript (13 lines) ----------
[
    9000,
    12000,
    18000,
    24000,
    30000,
    36000,
    45000,
    48000,
    50000,
    56000,
    60000
];
# ----------------------------------------
code_block_5 = CodeBlock(a=code_block_4) { a + " BTU/h"; }

# group: Gera as novas descrições para os novos tipos
code_block_6 = CodeBlock(fixo=codeblock.parte_fixa, novos_idetificadores=code_block_5) { separador = " - "; fixo + separador + novos_idetificadores; }

# group: Obtém os valores das partes que compõem a descrição do tipo base [TIPO]-[MATERIAL]-[LINHA]-[IDENTIFICADOR]
code_block_7 = CodeBlock { "Descrição"; }
getParameterValueByName_3 = Element.GetParameterValueByName(element=getParameterValueByName, parameterName=code_block_7)
code_block_8 = CodeBlock { " - "; }
split_2 = String.Split(string=getParameterValueByName_3, separator0=code_block_8)
codeblock_2 = CodeBlock(value=split_2)
# ---------- codeblock_2.designscript (8 lines) ----------
tipo = value[0];
material = value[1];
linha = value[2];
identificador = value[3];
separador = " - ";

// Saída
parte_fixa = tipo + separador + material + separador + linha;
# ----------------------------------------

# group: Gera as novas descrições para os novos tipos
code_block_9 = CodeBlock(fixo=codeblock_2.parte_fixa, novos_idetificadores=code_block_5) { separador = " - "; fixo + separador + novos_idetificadores; }

python_script = Python(IN[0]=getParameterValueByName, IN[1]=code_block_6.out1, IN[2]=code_block_9.out1)  # IronPython2
# ---------- python_script.python (45 lines) ----------
import clr
clr.AddReference('RevitAPI')
from Autodesk.Revit.DB import *

clr.AddReference('RevitServices')
import RevitServices
from RevitServices.Persistence import DocumentManager
from RevitServices.Transactions import TransactionManager
from System.Collections.Generic import List

doc = DocumentManager.Instance.CurrentDBDocument

# Entradas:
# IN[0]: ElementType base (ex: um tipo de duto)
# IN[1]: Lista de nomes para os novos tipos (ex: ["B", "C", "D"])
# IN[2]: Lista de descrições para os novos tipos (ex: ["Descrição B", "Descrição C", "Descrição D"])
base_elem = UnwrapElement(IN[0])
names = IN[1] if isinstance(IN[1], list) else [IN[1]]
descriptions = IN[2] if isinstance(IN[2], list) else [IN[2]]

newElems = []

TransactionManager.Instance.EnsureInTransaction(doc)

# Para cada novo nome e descrição, duplica o elemento base
for name, desc in zip(names, descriptions):
    # Cria uma lista com o ID do elemento base para copiar
    idList = List[ElementId]([base_elem.Id])
    copyids = ElementTransformUtils.CopyElements(doc, idList, doc, Transform.Identity, CopyPasteOptions())
    newElem = doc.GetElement(copyids[0])
    
    # Renomeia o novo tipo
    newElem.Name = name
    
    # Se existir o parâmetro "Descrição" ou "Description", define o valor
    param = newElem.LookupParameter("Descrição") or newElem.LookupParameter("Description")
    if param and not param.IsReadOnly:
        param.Set(desc)
    
    newElems.append(newElem)

TransactionManager.Instance.TransactionTaskDone()

# Saída: lista com os novos tipos criados
OUT = newElems
# ----------------------------------------
