# Dynamo graph CSFINALIZER - FINALIZAR CAIXA SIFONADA.dyn (Dynamo 3.3.0.6316)
# packages: Rhythm 2024.10.1, OpenMEP 1.0.0, Clockwork for Dynamo 2.x 2.12.2, BIMCoder Nodes - 2.X 2025.4.0

# group: Pacotes utilizados
# Descrição <Clique duas vezes aqui para editar a descrição do grupo>
# note: BIMCoder Nodes |
# Clockwork |
# OpenMEP | v.1.0.0
# Rhythm | v.2024.10.1

# group: Obtém os elementos no revit
# Descrição <Clique duas vezes aqui para editar a descrição do grupo>
boolean = BoolSelector(true)
categories = Categories("OST_PipeCurves")
categories_2 = Categories("OST_PlumbingFixtures")
join = List.Join(list0=categories, list1=categories_2)
code_block = CodeBlock { false; }
# note: Custom Node: Rhythmv.2024.10.1
ʳʰʸᵗʰᵐ_selection_pick = Rhythm.Revit.Selection.Selection.Pick(runIt=boolean, category=join, singleSelection=code_block)

# group: Separa os elementos pela categoria
# Descrição <Clique duas vezes aqui para editar a descrição do grupo>
getCategory = Element.GetCategory(element=ʳʰʸᵗʰᵐ_selection_pick)
code_block_2 = CodeBlock(a=getCategory) { a.Name == "Tubulação"; }
filterByBoolMask = List.FilterByBoolMask(list=ʳʰʸᵗʰᵐ_selection_pick, mask=code_block_2)

# group: Input do usuário
# Descrição <Clique duas vezes aqui para editar a descrição do grupo>
prâmetro_controle_do_prolongador = StringInput("Elevação do Ralo")  # graph input
correção_de_rererência = DoubleInput(0)  # graph input
espessura_da_grelha = DoubleInput(0.006)  # graph input

# group: Informações dos conectores das caixas sifonadas
# Descrição <Clique duas vezes aqui para editar a descrição do grupo>
# note: Custom Node: BIMCoder Nodes
connectors = Custom[👓 Connectors+](element=filterByBoolMask.out)  # package BIMCoder Nodes - 2.X; Obtém as propriedades mais relevantes dos conectores de elementos
flatten = List.Flatten(list=connectors.Points)
flatten_2 = List.Flatten(list=connectors.Connectors)
flatten_3 = List.Flatten(list=connectors.Direction)
flatten_4 = List.Flatten(list=connectors.Diameter)

# group: Informações dos conectores da tubulação
# Descrição <Clique duas vezes aqui para editar a descrição do grupo>
# note: Custom Node: BIMCoder Nodes
connectors_2 = Custom[👓 Connectors+](element=filterByBoolMask.in)
flatten_5 = List.Flatten(list=connectors_2.Connectors)
flatten_6 = List.Flatten(list=connectors_2.Points)

# group: Obtém os indices dos conectores mais próximos
# Descrição <Clique duas vezes aqui para editar a descrição do grupo>
# note: Custom Node: OpenMEPv.1.0.0
distanceTo = OpenMEPRevit.ConnectorManager.Connector.DistanceTo(connector1=flatten_5, connector2=flatten_2, lacing=CrossProduct)
python_script = Python(IN[0]=distanceTo)  # CPython3
# ---------- python_script.python (17 lines) ----------
# Dynamo Python (IronPython 3) – find the smallest value in a nested list
# IN[0]  → nested list of numbers (e.g. [[3,1,4],[5,4,2],[7,1,6]])
# OUT    → [outer_index, inner_index] of the first occurrence of the minimum value

nested = IN[0]

# Flatten while tracking indices
min_val  = None
min_idx  = [-1, -1]

for i, sub in enumerate(nested):
    for j, val in enumerate(sub):
        if (min_val is None) or (val < min_val):
            min_val = val
            min_idx = [i, j]

OUT = min_idx
# ----------------------------------------
code_block_3 = CodeBlock(a=python_script) { a[0]; a[1]; }

# group: Obtém a distância entre os dois conectores
# Descrição <Clique duas vezes aqui para editar a descrição do grupo>
getItemAtIndex = List.GetItemAtIndex(list=flatten, index=code_block_3.out1)
getItemAtIndex_2 = List.GetItemAtIndex(list=flatten_6, index=code_block_3.out0)
byTwoPoints = Vector.ByTwoPoints(start=getItemAtIndex, end=getItemAtIndex_2)
length = Vector.Length(vector=byTwoPoints)
code_block_4 = CodeBlock(a=length, b=correção_de_rererência) { a + b; }

# group: Ajusta o tamanho do prolongador na caixa sifonada
# Descrição <Clique duas vezes aqui para editar a descrição do grupo>
setParameterByName = Element.SetParameterByName(element=filterByBoolMask.out, parameterName=prâmetro_controle_do_prolongador, value=code_block_4)

# group: Obtém o ponto superior do prolongador
# Descrição <Clique duas vezes aqui para editar a descrição do grupo>
getLocation = Element.GetLocation(element=setParameterByName)
ZAxis = Vector.ZAxis()
reverse = Vector.Reverse(vector=ZAxis)
translate = Geometry.Translate(geometry=getLocation, direction=reverse, distance=espessura_da_grelha)

# group: Obtém o índice do conector vertical (Prolongador)
# Descrição <Clique duas vezes aqui para editar a descrição do grupo>
Z = Vector.Z(vector=flatten_3)
code_block_5 = CodeBlock(a=Z) { a == 1; }
code_block_6 = CodeBlock { true; }
indexOf = List.IndexOf(list=code_block_5, element=code_block_6)

# group: Obtém o ponto inferior do prolongador
# Descrição <Clique duas vezes aqui para editar a descrição do grupo>
getItemAtIndex_3 = List.GetItemAtIndex(list=flatten, index=indexOf)
ZAxis_2 = Vector.ZAxis()
reverse_2 = Vector.Reverse(vector=ZAxis_2)
translate_2 = Geometry.Translate(geometry=getItemAtIndex_3, direction=reverse_2, distance=code_block_4)

# group: Cria a linha que representa a tubulação
# Descrição <Clique duas vezes aqui para editar a descrição do grupo>
byStartPointEndPoint = Line.ByStartPointEndPoint(startPoint=translate, endPoint=translate_2)

# group: Obtém as informações da tubulação para o prolongador
# Descrição <Clique duas vezes aqui para editar a descrição do grupo>
code_block_7 = CodeBlock { ["Tipo", "Tipo de sistema"]; }
getParameterValueByName = Element.GetParameterValueByName(element=filterByBoolMask.in, parameterName=code_block_7, lacing=Longest)
codeblock = CodeBlock(value=getParameterValueByName) { tipoTubo = value[0]; sistemaTubo = value[1]; }
# note: Custom Node: OpenMEPv.1.0.0
getLevel = OpenMEPRevit.Element.Element.GetLevel(element=filterByBoolMask.in)

# group: Obtém diâmetro do prolongador
# Descrição <Clique duas vezes aqui para editar a descrição do grupo>
getItemAtIndex_4 = List.GetItemAtIndex(list=flatten_4, index=indexOf)

# group: Cria a tubulação no Revit
# Descrição <Clique duas vezes aqui para editar a descrição do grupo>
# note: Custom Node: BIMCoder Nodes
pipe_bylines = Custom[👓 Pipe․ByLines](lines=byStartPointEndPoint, pipeType=codeblock.tipoTubo, systemType=codeblock.sistemaTubo, level=getLevel, diameter=getItemAtIndex_4)  # package BIMCoder Nodes - 2.X; Modela tubulações (Pipes) com base em linhas (que devem ser geometrias)
flatten_7 = List.Flatten(list=pipe_bylines)

# group: Obtém a informação dos conectores
# Descrição <Clique duas vezes aqui para editar a descrição do grupo>
# note: Custom Node: BIMCoder Nodes
connectors_3 = Custom[👓 Connectors+](element=flatten_7)
flatten_8 = List.Flatten(list=connectors_3.Points)
flatten_9 = List.Flatten(list=connectors_3.Connectors)

# group: Obtém o conector com a cota mais baixa
# Descrição <Clique duas vezes aqui para editar a descrição do grupo>
code_block_8 = CodeBlock(a=flatten_8) { a.Z; }
flatten_10 = List.Flatten(list=code_block_8)
minimumItem = List.MinimumItem(list=code_block_8)
indexOf_2 = List.IndexOf(list=code_block_8, element=minimumItem)
getItemAtIndex_5 = List.GetItemAtIndex(list=flatten_9, index=indexOf_2)

prolongador_criado = Watch(flatten_7)  # graph output

# group: Conecta o connector da tubulação com o connector da caixa
# Descrição <Clique duas vezes aqui para editar a descrição do grupo>
list_getitematindex_connector = List.GetItemAtIndex(list=flatten_5, index=code_block_3.out0)
# note: Custom Node: Clockwork
passthrough = Custom[Passthrough](passThrough=list_getitematindex_connector, waitFor=setParameterByName)  # package Clockwork for Dynamo 2.x; Forces a sequential order of execution. The node wired into the output of the Passthrough node will be executed *after* the node wired into the waitFor input (e.g. important for some Revit operations). The value of the passThrough input will be passed on to the node wired into the output port of the Passthrough node.
list_getitematindex_conecctor = List.GetItemAtIndex(list=flatten_2, index=code_block_3.out1)
passthrough_2 = Custom[Passthrough](passThrough=list_getitematindex_conecctor, waitFor=setParameterByName)
# note: Custom Node: OpenMEPv.1.0.0
connectTo = OpenMEPRevit.ConnectorManager.Connector.ConnectTo(connector=passthrough, connectorFrom=passthrough_2)

# group: Obtém o conector do prolongador
# Descrição <Clique duas vezes aqui para editar a descrição do grupo>
getItemAtIndex_6 = List.GetItemAtIndex(list=flatten_2, index=indexOf)

# group: Connecta o prolongador a caixa sifonada
# Descrição <Clique duas vezes aqui para editar a descrição do grupo>
# note: Custom Node: OpenMEPv.1.0.0
connectTo_2 = OpenMEPRevit.ConnectorManager.Connector.ConnectTo(connector=getItemAtIndex_5, connectorFrom=getItemAtIndex_6)

# group: Output
# Descrição <Clique duas vezes aqui para editar a descrição do grupo>
join_2 = List.Join(list0=connectTo, list1=connectTo_2)
conexões_realizadas = Watch(join_2)  # graph output
