# Dynamo graph MOVER E CONECTAR ELEMENTOS.dyn "CSFinalizer - Finalizar Caixa Sifonada" (Dynamo 3.3.0.6316)
# packages: MEPover 2024.9.25, OpenMEP 1.0.0, Clockwork for Dynamo 2.x 2.12.2, Rhythm 2024.10.1

# group: Obtém o elemento fixo no Revit
# Descrição <Clique duas vezes aqui para editar a descrição do grupo>
boolean = BoolSelector(true)
code_block = CodeBlock { true; }
ʳʰʸᵗʰᵐ_selection_pick = Rhythm.Revit.Selection.Selection.Pick(runIt=boolean, singleSelection=code_block)
mep_connector_info = Custom[MEP Connector info+](element=ʳʰʸᵗʰᵐ_selection_pick)  # package MEPover; This node will return the connectors and a lot of information about those connectors of the input elements

# group: Obtém o elemento móvel no Revit
# Descrição <Clique duas vezes aqui para editar a descrição do grupo>
passthrough = Custom[Passthrough](passThrough=boolean, waitFor=ʳʰʸᵗʰᵐ_selection_pick)  # package Clockwork for Dynamo 2.x; Forces a sequential order of execution. The node wired into the output of the Passthrough node will be executed *after* the node wired into the waitFor input (e.g. important for some Revit operations). The value of the passThrough input will be passed on to the node wired into the output port of the Passthrough node.
code_block_2 = CodeBlock { true; }
ʳʰʸᵗʰᵐ_selection_pick_2 = Rhythm.Revit.Selection.Selection.Pick(runIt=passthrough, singleSelection=code_block_2)
mep_connector_info_2 = Custom[MEP Connector info+](element=ʳʰʸᵗʰᵐ_selection_pick_2)

# group: Obtém os indices dos conectores mais próximos
# Descrição <Clique duas vezes aqui para editar a descrição do grupo>
distanceTo = OpenMEPRevit.ConnectorManager.Connector.DistanceTo(connector1=mep_connector_info.Connectors, connector2=mep_connector_info_2.Connectors, lacing=CrossProduct)
python_script = Python(IN[0]=distanceTo)  # CPython3
# ---------- python_script.python (17 lines) ----------
# Dynamo Python (IronPython 3) – find the smallest value in a nested list
# IN[0]  → nested list of numbers (e.g. [[3,1,4],[5,4,2],[7,1,6]])
# OUT    → [outer_index, inner_index] of the first occurrence of the minimum value

nested = IN[0]

# Flatten while tracking indices
min_val  = None
min_idx  = [-1, -1]

for i, sub in enumerate(nested):
    for j, val in enumerate(sub):
        if (min_val is None) or (val < min_val):
            min_val = val
            min_idx = [i, j]

OUT = min_idx
# ----------------------------------------
code_block_3 = CodeBlock(a=python_script) { a[0]; a[1]; }

# group: Obtém o vetor que representa a distância entre os dois pontos
# Descrição <Clique duas vezes aqui para editar a descrição do grupo>
getItemAtIndex = List.GetItemAtIndex(list=mep_connector_info_2.Points, index=code_block_3.out1)
getItemAtIndex_2 = List.GetItemAtIndex(list=mep_connector_info.Points, index=code_block_3.out0)
byTwoPoints = Vector.ByTwoPoints(start=getItemAtIndex, end=getItemAtIndex_2)

# group: Move a conexão até o outro conector
# Descrição <Clique duas vezes aqui para editar a descrição do grupo>
start = Revit.Transaction.Transaction.Start(input=ʳʰʸᵗʰᵐ_selection_pick_2)
start_2 = Revit.Transaction.Transaction.Start(input=byTwoPoints)
moveByVector = Element.MoveByVector(element=start, vector=start_2)
end = Revit.Transaction.Transaction.End(input=moveByVector)

# group: Conecta dois elementos
# Descrição <Clique duas vezes aqui para editar a descrição do grupo>
list_getitematindex_connector = List.GetItemAtIndex(list=mep_connector_info.Connectors, index=code_block_3.out0)
passthrough_2 = Custom[Passthrough](passThrough=list_getitematindex_connector, waitFor=end)
list_getitematindex_conecctor = List.GetItemAtIndex(list=mep_connector_info_2.Connectors, index=code_block_3.out1)
passthrough_3 = Custom[Passthrough](passThrough=list_getitematindex_conecctor, waitFor=end)
connectTo = OpenMEPRevit.ConnectorManager.Connector.ConnectTo(connector=passthrough_2, connectorFrom=passthrough_3)
